# Grasshopper definition notuniform.gh (Grasshopper 0.9.76)

radius = Slider(73.883, range=0..100)
pt = ConstructPoint(XCoordinate=0, YCoordinate=0, ZCoordinate=0)
circle = CircleCNR(Center=pt, Normal=Vector(0, 0, 1), Radius=radius)
radgrid = Radial(Plane=PlaneXY(0, 0, 0), Size=Slider(2, range=0..10), ExtentR=Slider(7, range=1..100), ExtentP=Slider(21, range=1..100))  # -> Cells, Points
dist = Distance(PointA=pt, PointB=radgrid.Points)
division = Division(A=dist, B=Slider(8.057, range=2..50))
circle_2 = CircleCNR(Center=radgrid.Points, Normal=Vector(0, 0, 1), Radius=division)
