# Grasshopper definition skeletalMbetter.gh (Grasshopper 0.8.66)

Z = UnitZ(Factor=Slider(10, range=0..100))
pt = Point([Point(25, 2, 0), Point(25, 10, 0), Point(33, 10, 0), Point(33, 2, 0)])
move = Move(Geometry=pt, Motion=Z)  # -> Geometry, Transform

pt_2 = Point([move.Geometry, pt])
voronoi³ = Voronoi3D(Points=pt_2)  # -> Cells, Boundary
scale = Scale(Geometry=voronoi³.Cells, Center=pt_2, Factor=Slider(0.08, range=0.01..1))  # -> Geometry, Transform
explode = BrepComponents(Brep=scale.Geometry)  # -> Faces, Edges, Vertices
explode_2 = BrepComponents(Brep=explode.Faces)  # -> Faces, Edges, Vertices
join = JoinCurves(Curves=explode_2.Edges, Preserve=False)  # -> flatten(Curves)

explode_3 = BrepComponents(Brep=voronoi³.Cells)  # -> Faces, Edges, Vertices
explode_4 = BrepComponents(Brep=explode_3.Faces)  # -> Faces, Edges, Vertices
join_2 = JoinCurves(Curves=explode_4.Edges, Preserve=False)  # -> flatten(Curves)
pcen = PolygonCenter(Polyline=join_2)  # -> CenterV, CenterE
lng = ListLength(List=pcen.CenterE)
sort_pt = SortPoints(Points=pcen.CenterE)  # -> Points, Indices
series = Series(Start=0, Step=1, Count=lng)
sort = SortList(Keys=sort_pt.Indices, ValuesA=series)  # -> Keys, ValuesA
replace = ListReplace(List=join, Item=join, Indices=sort.ValuesA, Wrap=False)
shift = ShiftList(List=sort_pt.Points, Shift=-1, Wrap=True)
shift_2 = ShiftList(List=sort_pt.Points, Shift=1, Wrap=True)
dist = Distance(PointA=shift, PointB=sort_pt.Points)
dist_2 = Distance(PointA=shift_2, PointB=sort_pt.Points)
smaller = SmallerThan(FirstNumber=dist_2, SecondNumber=0.01)  # -> SmallerThan, OrEqualTo
smaller_2 = SmallerThan(FirstNumber=dist, SecondNumber=0.01)  # -> SmallerThan, OrEqualTo
cull = CullPattern(List=replace, CullPattern=smaller.SmallerThan)  # -> graft(List)
cull_2 = CullPattern(List=replace, CullPattern=smaller_2.SmallerThan)  # -> graft(List)
data = Data([cull_2, cull])

data_2 = Data(data)
pcen_2 = PolygonCenter(Polyline=data_2)  # -> CenterV, CenterE
item = ListItem(List=pcen_2.CenterE, Index=1, Wrap=False)
item_2 = ListItem(List=pcen_2.CenterE, Index=0, Wrap=False)
item_3 = ListItem(List=data_2, Index=0, Wrap=False)
vec2pt = Vector2Pt(PointA=item_2, PointB=item, Unitize=False)  # -> Vector, Length
extr = Extrude(Base=item_3, Direction=vec2pt.Vector)
explode_5 = BrepComponents(Brep=extr)  # -> Faces, Edges, Vertices
explode_6 = BrepComponents(Brep=explode_5.Faces)  # -> Faces, Edges, Vertices
item_4 = ListItem(List=explode_6.Vertices, Index=2, Wrap=False)
item_5 = ListItem(List=explode_6.Vertices, Index=3, Wrap=False)
item_6 = ListItem(List=explode_6.Vertices, Index=1, Wrap=False)
item_7 = ListItem(List=explode_6.Vertices, Index=0, Wrap=False)
quad = MeshQuad(CornerA=0, CornerB=1, CornerC=3, CornerD=2)
mesh = Mesh(Vertices=[item_6, item_7, item_4, item_5], Faces=quad)  # -> flatten(Mesh)

equals = Equality(FirstNumber=smaller.OrEqualTo, SecondNumber=smaller_2.OrEqualTo)  # -> Equality, Inequality
cull_3 = CullPattern(List=replace, CullPattern=equals.Equality)
planar = PlanarSrf(Edges=cull_3)
mesh_2 = MeshBrep(
    Brep=planar,
    Settings={Refine=True, JaggedSeams=False, SimplePlanes=True, GridMinCount=16, GridMaxCount=0, Tolerance=0, RefineAngle=0, MinTolerance=0, RelativeTolerance=0.65, MinEdgeLength=0.0001, MaxEdgeLength=0})
quad_2 = Quadrangulate(Mesh=mesh_2, Angle=3.141592654, Ratio=10000)  # -> Mesh, Count

wbjoin = WeaverBirdsJoinMeshesAndWeld(Mesh=flatten([mesh, quad_2.Mesh]), Weld=True)
weldvertices = MeshWeldVertices(Mesh=wbjoin, Tolerance=0.01)  # -> RuntimeMessage, Mesh
vb = VBScript(x=weldvertices.Mesh)  # -> out, A; inputs x: Mesh
# ---------- vb: C# ----------
    x.Normals.ComputeNormals
    x.FaceNormals.ComputeFaceNormals
    x.UnifyNormals
    A = x
# ---------- end vb ----------
wblaplace = WeaverBirdsLaplacianSmoothing(MeshCurves=vb.A, Level=1, SmoothNakedEdges=1, Thin=Slider(1.769, range=0..10))
wbcatmullclark = WeaverBirdsCatmullClarkSubdivision(MeshCurves=wblaplace, Level=3, SmoothNakedEdges=1)
preview = CustomPreview(Geometry=wbcatmullclark, Shader=ColourSwatch(SwatchColor=RGB(219, 219, 219)))
