# Grasshopper definition skeletal_mesh (1).gh (Grasshopper 0.8.66)

R = Region({Plane=PlaneXY(0, 0, 0), X=Domain(0, 20), Y=Domain(0, 20), Z=Domain(0, 20)})
pop3d = Populate3D(Region=R, Count=30, Seed=111)
voronoi³ = Voronoi3D(Points=pop3d, Box=R)  # -> Cells, Boundary
explode = BrepComponents(Brep=voronoi³.Cells)  # -> Faces, Edges, Vertices
volume = Volume(Geometry=voronoi³.Cells)  # -> Volume, Centroid
scale = Scale(Geometry=explode.Faces, Center=graft(volume.Centroid), Factor=Slider(0.811, range=0..1))  # -> Geometry, Transform
area = Area(Geometry=explode.Faces)  # -> Area, Centroid
scale_2 = Scale(Geometry=explode.Faces, Center=area.Centroid, Factor=Slider(0.727, range=0..1))  # -> Geometry, Transform
explode_2 = BrepComponents(Brep=scale.Geometry)  # -> Faces, Edges, Vertices
explode_3 = BrepComponents(Brep=scale_2.Geometry)  # -> Faces, Edges, Vertices
volume_2 = Volume(Geometry=R)  # -> Volume, Centroid
end = EndPoints(Curve=explode_3.Edges)  # -> graft(Start), graft(End)
end_2 = EndPoints(Curve=explode_2.Edges)  # -> graft(Start), graft(End)
scale_3 = Scale(Geometry=R, Center=volume_2.Centroid, Factor=Slider(0.888, range=0..1))  # -> Geometry, Transform
pt = Point([end.Start, end.End, end_2.Start, end_2.End])
quad = MeshQuad(CornerA=0, CornerB=1, CornerC=3, CornerD=2)
mesh = Mesh(Vertices=pt, Faces=quad)
in = Inside(Brep=scale_3.Geometry, Point=pt, Strict=False)
ma = MassAddition(Input=in)  # -> Result, PartialResults
larger = LargerThan(FirstNumber=ma.Result, SecondNumber=0)  # -> LargerThan, OrEqualTo
cull = CullPattern(List=mesh, CullPattern=larger.LargerThan)
wbjoin = JoinMeshesAndWeld(Mesh=flatten(cull), Weld=True)
wbcatmullclark = WeaverBirdsCatmullClarkSubdivision(MeshCurves=wbjoin, Level=2, SmoothNakedEdges=1)
