# Grasshopper definition skeletal_mesh.gh (Grasshopper 0.9.76)
# plug-ins: Weaverbird

pop3d = Populate3D(Region={Plane=PlaneXY(0, 0, 0), X=Domain(0, 10), Y=Domain(0, 10), Z=Domain(0, 2)}, Count=100, Seed=1)
R = Region({Plane=PlaneXY(0, 0, 0), X=Domain(0, 20), Y=Domain(0, 20), Z=Domain(0, 20)})
voronoi³ = Voronoi3D(Points=pop3d, Box=R)  # -> Cells, Boundary
explode = BrepComponents(Brep=voronoi³.Cells)  # -> Faces, Edges, Vertices
volume = Volume(Geometry=voronoi³.Cells)  # -> Volume, Centroid
pt = ConstructPoint(XCoordinate="-10", YCoordinate="-10", ZCoordinate="-10")
pt_2 = ConstructPoint(XCoordinate="10", YCoordinate="10", ZCoordinate="10")
area = Area(Geometry=explode.Faces)  # -> Area, Centroid
scale = Scale(Geometry=explode.Faces, Center=volume.Centroid, Factor=Slider(0.57, range=0..1))  # -> Geometry, Transform
box = Box2Pt(PointA=pt, PointB=pt_2, Plane=PlaneXY(0, 0, 0))
scale_2 = Scale(Geometry=explode.Faces, Center=area.Centroid, Factor=Slider(0.939, range=0..1))  # -> Geometry, Transform
explode_2 = BrepComponents(Brep=scale.Geometry)  # -> Faces, Edges, Vertices
volume_2 = Volume(Geometry=R)  # -> Volume, Centroid
explode_3 = BrepComponents(Brep=scale_2.Geometry)  # -> Faces, Edges, Vertices
pop3d_2 = Populate3D(Region=box, Count=Slider(18, range=10..100), Seed=1)
end = EndPoints(Curve=explode_2.Edges)  # -> graft(Start), graft(End)
end_2 = EndPoints(Curve=explode_3.Edges)  # -> graft(Start), graft(End)
pdecon = Deconstruct(Point=pop3d_2)  # -> XComponent, YComponent, ZComponent
pt_3 = Point([end_2.Start, end_2.End, end.Start, end.End])
polar = ToPolar(Point=pop3d_2, System=PlaneXY(0, 0, 0))  # -> Phi, Theta, Radius
quad = MeshQuad(CornerA=0, CornerB=1, CornerC=3, CornerD=2)
scale_3 = Scale(Geometry=R, Center=volume_2.Centroid, Factor=Slider(0.88, range=0..1))  # -> Geometry, Transform
in = Inside(Brep=scale_3.Geometry, Point=pt_3, Strict=False)
multiplication = Multiplication(A=polar.Radius, B=Slider(1, range=0..1))
bnd = Bounds(Numbers=multiplication)
remap = RemapNumbers(Value=multiplication, Source=bnd, Target=Domain(0, 1))  # -> Mapped, Clipped
mesh = Mesh(Vertices=pt_3, Faces=quad)
ma = MassAddition(Input=in)  # -> Result, PartialResults
graph = GraphMapper(remap.Mapped, x0=0, x1=1, y0=0, y1=1, container_name="Conic", Cx=0.258652091, Cy=0.4558472633)
larger = LargerThan(FirstNumber=ma.Result, SecondNumber=0)  # -> LargerThan, OrEqualTo
remap_2 = RemapNumbers(Value=graph, Source=Domain(0, 1), Target=bnd)  # -> Mapped, Clipped
pt_4 = PointPolar(BasePlane=PlaneXY(0, 0, 0), XYAngle=polar.Phi, ZAngle=polar.Theta, Offset=remap_2.Mapped)
cull = CullPattern(List=mesh, CullPattern=larger.LargerThan)
wbjoin = JoinMeshesAndWeld(Mesh=flatten(cull), Weld=True)
wbcatmullclark = WeaverBirdsCatmullClarkSubdivision(MeshCurves=flatten(wbjoin), Level=2, SmoothNakedEdges=1)
