# Grasshopper definition skeletal_mesh_orig.gh (Grasshopper 0.9.76)
# plug-ins: Kangaroo Components, Weaverbird, IntraLattice

R = Region({Plane=PlaneXY(0, 0, 0), X=Domain(0, 20), Y=Domain(0, 20), Z=Domain(0, 20)})
pop3d = Populate3D(Region=R, Count=30, Seed=111)
voronoi³ = Voronoi3D(Points=pop3d, Box=R)  # -> Cells, Boundary
number_slider = Slider(6, range=0..10)
number_slider_2 = Slider(1, range=0..1)
number_slider_3 = Slider(1, range=0..1)
explode = BrepComponents(Brep=voronoi³.Cells)  # -> Faces, Edges, Vertices
volume = Volume(Geometry=voronoi³.Cells)  # -> Volume, Centroid
line = Line(explode.Edges)
number_slider_4 = Slider(9, range=0..10)
scale = Scale(Geometry=explode.Faces, Center=graft(volume.Centroid), Factor=Slider(0.811, range=0..1))  # -> Geometry, Transform
area = Area(Geometry=explode.Faces)  # -> Area, Centroid
dupln = RemoveDuplicateLines(Lines=line, Tolerance=0.01)  # -> flatten(UniqueLines)
scale_2 = Scale(Geometry=explode.Faces, Center=area.Centroid, Factor=Slider(0.727, range=0..1))  # -> Geometry, Transform
explode_2 = BrepComponents(Brep=scale.Geometry)  # -> Faces, Edges, Vertices
explode_3 = BrepComponents(Brep=scale_2.Geometry)  # -> Faces, Edges, Vertices
end = EndPoints(Curve=explode_2.Edges)  # -> graft(Start), graft(End)
volume_2 = Volume(Geometry=R)  # -> Volume, Centroid
end_2 = EndPoints(Curve=explode_3.Edges)  # -> graft(Start), graft(End)
homogen = Homogen(
    lattice_wireframe=dupln,
    strut_radius=Slider(0.2, range=0..1),
    tolerance_factor=Slider(3, range=0..10),
    strut_sides=Slider(6, range=0..10),
    node_size=Slider(0.1, range=0..1),
    strut_division=Slider(1, range=0..10))
scale_3 = Scale(Geometry=R, Center=volume_2.Centroid, Factor=Slider(0.888, range=0..1))  # -> Geometry, Transform
pt = Point([end_2.Start, end_2.End, end.Start, end.End])
quad = MeshQuad(CornerA=0, CornerB=1, CornerC=3, CornerD=2)
mesh = Mesh(Vertices=pt, Faces=quad)
in = Inside(Brep=scale_3.Geometry, Point=pt, Strict=False)
ma = MassAddition(Input=in)  # -> Result, PartialResults
larger = LargerThan(FirstNumber=ma.Result, SecondNumber=0)  # -> LargerThan, OrEqualTo
fr_random = FrameRandom(Tolerance=0.01)  # -> LatticeFrame, NodePosition, StartNode, EndNode
cull = CullPattern(List=mesh, CullPattern=larger.LargerThan)
wbjoin = JoinMeshesAndWeld(Mesh=flatten(cull), Weld=True)
wbcatmullclark = WeaverBirdsCatmullClarkSubdivision(MeshCurves=wbjoin, Level=2, SmoothNakedEdges=1)

# ==== cluster Homogen: Generates homogeneous mesh from lattice wireframe.
strut_division = ClusterInput()  # Segment division along strut (mm).
strut_sides = ClusterInput()  # Number of sides to strut. Recommended value is '9'.
node_size = ClusterInput()  # Depth of nodes (mm).
strut_radius = ClusterInput()  # Radius of lattice struts (mm).
lattice_wireframe = ClusterInput()  # Lattice wireframe as line list.
tolerance_factor = ClusterInput()  # Points closer than (this times radius) will be merged.
multiplication = Multiplication(A=strut_radius, B=tolerance_factor)
topo = Topologizer(LinesInput=lattice_wireframe, Tolerance=multiplication)  # -> L, P, S, E, N, I, O, G
exow = ExoWireframe(
    Lines=topo.L,
    Sides=strut_sides,
    StartRadius=strut_radius,
    EndRadius=strut_radius,
    NodeDepth=node_size,
    Division=strut_division,
    Open=False)
lattice_mesh = ClusterOutput(exow)  # Generated lattice mesh.
