# Grasshopper definition skeletalrechteck02.gh (Grasshopper 0.9.14)
# plug-ins: MeshEdit Components, Weaverbird

crv = Curve(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)
brep = Brep(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)
bbox = BoundingBox(Content=brep, Plane=PlaneXY(0, 0, 0), UnionBox=True)  # -> Box, Box_2
pop3d = Populate3D(Region=bbox.Box, Count=Slider(100, range=0..1000), Seed=1)
inmul = InsideMultiple(Brep=brep, Point=pop3d, Strict=False)  # -> Inside, Index
cull = CullPattern(List=pop3d, CullPattern=inmul.Inside)
avr = Average(Input=cull)
scale = Scale(Geometry=bbox.Box, Center=avr, Factor=Slider(1.282, range=0..5))  # -> Geometry, Transform
voronoi³ = Voronoi3D(Points=cull, Box=scale.Geometry)  # -> Cells, Boundary
sint = SolidIntersection(BrepsA=brep, BrepsB=graft(voronoi³.Cells))
explode = BrepComponents(Brep=sint)  # -> Faces, Edges, Vertices
area = Area(Geometry=explode.Faces)  # -> Area, Centroid
explode_2 = Explode(Curve=explode.Faces, Recursive=True)  # -> Segments, Vertices
group = Group(Objects=explode_2.Segments)
avr_2 = Average(Input=explode.Vertices)
pshift = ShiftPaths(Data=group, Offset=-1)
crv_cp = CurveCP(Point=avr_2, Curve=crv)  # -> Point, Parameter, Distance
crv_cp_2 = CurveCP(Point=area.Centroid, Curve=crv)  # -> Point, Parameter, Distance
bnd = Bounds(Numbers=flatten(crv_cp_2.Distance))
bnd_2 = Bounds(Numbers=flatten(crv_cp.Distance))
remap = RemapNumbers(Value=crv_cp_2.Distance, Source=bnd, Target="0.9 to 0.3")
remap_2 = RemapNumbers(Value=crv_cp.Distance, Source=bnd_2, Target="0.95 to 0.35")
graph = GraphMapper(remap, x0=0, x1=1, y0=0, y1=1, container_name="Bezier", cpx=[0, 0.8016759753, 0.5055865645, 1], cpy=[0, 0, 1, 1])
graph_2 = GraphMapper(remap_2, x0=0, x1=1, y0=0, y1=1, container_name="Bezier", cpx=[0, 0.7960894108, 0.4972067177, 1], cpy=[0, 0, 1, 1])
scale_2 = Scale(Geometry=pshift, Center=area.Centroid, Factor=graph)  # -> Geometry, Transform
scale_3 = Scale(Geometry=pshift, Center=avr_2, Factor=graph_2)  # -> Geometry, Transform
ungroup = Ungroup(Group=scale_3.Geometry)
ungroup_2 = Ungroup(Group=scale_2.Geometry)
end = EndPoints(Curve=simplify(ungroup_2))  # -> graft(Start), graft(End)
end_2 = EndPoints(Curve=simplify(ungroup))  # -> graft(Start), graft(End)
end_3 = EndPoints(Curve=simplify(explode_2.Segments))  # -> graft(Start), graft(End)
end_4 = EndPoints(Curve=simplify(ungroup_2))  # -> graft(Start), graft(End)
pt = Point([end_2.Start, end_2.End, end.Start, end.End])
pt_2 = Point([end_3.Start, end_3.End, end_4.Start, end_4.End])
clean = CleanTree(Data=pt_2, CleanInvalid=True, CleanEmpty="1")
clean_2 = CleanTree(Data=pt, CleanInvalid=True, CleanEmpty="1")
quad = MeshQuad(CornerA=0, CornerB=1, CornerC=3, CornerD=2)
quad_2 = MeshQuad(CornerA=0, CornerB=1, CornerC=3, CornerD=2)
mesh = Mesh(Vertices=clean_2, Faces=quad_2)
mesh_2 = Mesh(Vertices=clean, Faces=quad)
pshift_2 = ShiftPaths(Data=mesh_2, Offset=-1)
mjoin = MeshJoin(Meshes=pshift_2)  # -> flatten(Mesh)
cullpt = CullDuplicates(Points=flatten(area.Centroid), Tolerance="0.01", CullMode=2)  # -> Points, Indices, Valence
item = ListItem(List=mjoin, Index=cullpt.Indices, Wrap=False)
mjoin_2 = MeshJoin(Meshes=flatten([mesh, item]))
weldvertices = MeshWeldVertices(Mesh=mjoin_2, Tolerance="0.001")  # -> RuntimeMessage, Mesh
unifynormals = MeshUnifyNormals(Mesh=weldvertices.Mesh)
wbloop = WeaverbirdsLoopSubdivision(MeshCurves=unifynormals, Level="3", SmoothNakedEdges=1)
