# Grasshopper definition variable_density.gh (Grasshopper 0.9.76)

pt = ConstructPoint(XCoordinate="-50", YCoordinate="-50", ZCoordinate="-50")
pt_2 = ConstructPoint(XCoordinate="50", YCoordinate="50", ZCoordinate="50")
box = Box2Pt(PointA=pt, PointB=pt_2, Plane=PlaneXY(0, 0, 0))
pop3d = Populate3D(Region=box, Count=Slider(1000, range=100..10000), Seed=1)
pdecon = Deconstruct(Point=pop3d)  # -> XComponent, YComponent, ZComponent
polar = ToPolar(Point=pop3d, System=PlaneXY(0, 0, 0))  # -> Phi, Theta, Radius
multiplication = Multiplication(A=polar.Radius, B=Slider(0.5, range=0..1))
bnd = Bounds(Numbers=multiplication)
remap = RemapNumbers(Value=multiplication, Source=bnd, Target=Domain(0, 1))  # -> Mapped, Clipped
graph = GraphMapper(remap.Mapped, x0=0, x1=1, y0=0, y1=1, container_name="Conic", Cx=0.500910759, Cy=0.9284009337)
remap_2 = RemapNumbers(Value=graph, Source=Domain(0, 1), Target=bnd)  # -> Mapped, Clipped
pt_3 = PointPolar(BasePlane=PlaneXY(0, 0, 0), XYAngle=polar.Phi, ZAngle=polar.Theta, Offset=remap_2.Mapped)
